# Grasshopper definition Bend.gh (Grasshopper 0.9.75)
# plug-ins: Jackalope

Z = Slider(0, range=-10..10)
Y = Slider(19.7, range=-20..20)
degrees = Slider(30, range=0..360)
pt = Point(Point(20, 2, 2))
pt_2 = Point(Point(0, -2, -2))
pt_3 = Point(Point(10, 0, 0))
symetric = BooleanToggle(True)
pt_4 = Point(Point(0, 0, 0))
straight = BooleanToggle(False)
quick_prevew = BooleanToggle(False)
preserve_structure = BooleanToggle(False)
box = Box2Pt(PointA=pt_2, PointB=pt, Plane=PlaneXY(0, 0, 0))
ln = Line(StartPoint=pt_4, EndPoint=pt_3)
pt_5 = ConstructPoint(XCoordinate="20", YCoordinate=Y, ZCoordinate=Z)
brep = Brep(box)
rad = Radians(Degrees=degrees)
bend = Bend(
    Geometry=brep,
    Axis=ln,
    Point=pt_5,
    Angle=-1.234321012e+308,
    Straight=straight,
    Symmetric=symetric,
    Preserve=preserve_structure,
    Quick=quick_prevew)
panel = Panel(bend)
