# Grasshopper definition Flow.gh (Grasshopper 0.9.75)
# plug-ins: Jackalope

pt = Point(Point(20, 2, 2))
pt_2 = Point(Point(0, -2, -2))
pt_3 = Point(Point(20, 0, 0))
pt_4 = Point(Point(0, 0, 0))
pt_5 = Point(Point(0, 0, 0))
X = Slider(30, range=0..40)
pt_6 = Point(Point(10, 6, 0))
prevent_stretching = BooleanToggle(False)
quick_prevew = BooleanToggle(False)
preserve_structure = BooleanToggle(False)
box = Box2Pt(PointA=pt_2, PointB=pt, Plane=PlaneXY(0, 0, 0))
ln = Line(StartPoint=pt_4, EndPoint=pt_3)
pt_7 = ConstructPoint(XCoordinate=X, YCoordinate="0", ZCoordinate="0")
brep = Brep(box)
intcrv_t = InterpolateT(Vertices=[pt_5, pt_6, pt_7], Degree=3, TangentStart=Vector(0, 0, 0), TangentEnd=Vector(0, 0, 0), KnotStyle=1)  # -> Curve, Length, Domain
flow = Flow(
    Geometry=brep,
    Base=ln,
    Target=intcrv_t.Curve,
    ReverseBase=False,
    ReverseTarget=False,
    Prevent=prevent_stretching,
    Preserve=preserve_structure,
    Quick=quick_prevew)
panel = Panel(flow)
