# Grasshopper definition Stretch.gh (Grasshopper 0.9.75)
# plug-ins: Jackalope

pt = Point(Point(20, 2, 2))
pt_2 = Point(Point(0, -2, -2))
X = Slider(18.7, range=0..40)
pt_3 = Point(Point(20, 0, 0))
pt_4 = Point(Point(0, 0, 0))
length = Slider(20, range=0..20)
quick_prevew = BooleanToggle(False)
preserve_structure = BooleanToggle(False)
box = Box2Pt(PointA=pt_2, PointB=pt, Plane=PlaneXY(0, 0, 0))
ln = Line(StartPoint=pt_4, EndPoint=pt_3)
pt_5 = ConstructPoint(XCoordinate=X, YCoordinate="0", ZCoordinate="0")
brep = Brep(box)
stretch = Stretch(Geometry=brep, Axis=ln, Point=pt_5, Length=-1.234321012e+308, Preserve=preserve_structure, Quick=quick_prevew)
panel = Panel(stretch)
