# Grasshopper definition Taper.gh (Grasshopper 0.9.70)
# plug-ins: Jackalope

start_radius = Slider(5, range=0..10)
endt_radius = Slider(6.7, range=0..10)
flat = BooleanToggle(False)
infinite_taper = BooleanToggle(True)
preserve_structure = BooleanToggle(False)
quick_prevew = BooleanToggle(False)
pt = Point(Point(0, -2, -2))
pt_2 = Point(Point(20, 2, 2))
pt_3 = Point(Point(10, 0, 0))
pt_4 = Point(Point(0, 0, 0))
box = Box2Pt(PointA=pt, PointB=pt_2, Plane=PlaneXY(0, 0, 0))
ln = Line(StartPoint=pt_4, EndPoint=pt_3)
brep = Brep(box)
taper = Taper(
    Geometry=brep,
    Axis=ln,
    Start=start_radius,
    End=endt_radius,
    Flat=flat,
    Infinite=infinite_taper,
    Preserve=preserve_structure,
    Quick=quick_prevew)
panel = Panel(taper)
