# Grasshopper definition Twist.gh (Grasshopper 0.9.70)
# plug-ins: Jackalope

infinite_twist = BooleanToggle(False)
preserve_structure = BooleanToggle(False)
quick_prevew = BooleanToggle(False)
pt = Point(Point(0, -2, -2))
pt_2 = Point(Point(20, 2, 2))
pt_3 = Point(Point(20, 0, 0))
pt_4 = Point(Point(0, 0, 0))
box = Box2Pt(PointA=pt, PointB=pt_2, Plane=PlaneXY(0, 0, 0))
ln = Line(StartPoint=pt_4, EndPoint=pt_3)
rad = Radians(Degrees=Slider(507, range=0..720))
brep = Brep(box)
twist = Twist(
    Geometry=brep,
    Axis=ln,
    Angle=rad,
    InfiniteTwist=infinite_twist,
    PreserveStructure=preserve_structure,
    QuickPreview=quick_prevew)
panel = Panel(twist)
